# Grasshopper definition centerline.ghx (Grasshopper 1.0.8)

number_slider = Slider(10, range=0..10)
mesh = Mesh(<mesh referenced from the Rhino model>)
triremesh = TriRemesh(Geometry=mesh, Length=number_slider, Iterations=25)  # -> Triangulation, Dual, Creases
curve = Curve([<curve referenced from the Rhino model> x10])
mesh_2 = Mesh(<mesh referenced from the Rhino model>)  # disabled
growthcenter = Python3Script(sections=curve)  # -> out, maximum_inscribed_circle, growth_center; inputs sections: list of Curve
# ---------- growthcenter: Python ----------
#locate file in the same folder
from ghpythonlib.treehelpers import list_to_tree, tree_to_list
from compas_rhino import unload_modules
from compas_rhino.conversions import curve_to_compas, box_to_rhino, point_to_rhino, polyline_to_rhino
from compas.geometry import Polyline, Point, Circle, Frame
import sys
import os

import compas_cgal

print(compas_cgal.__version__)

#get current file path
path = ghenv.Component.OnPingDocument().FilePath
print (path)
#get parent directory of the parent directory
parentdir = os.path.dirname(path)
print (parentdir)
#get src folder which contains classes
dire = os.path.join(parentdir,'src')
print (dire)

sys.path.append(dire)

unload_modules('helpers')
unload_modules('growth_center')

import growth_center as gc
import helpers

curves = [curve_to_compas(s) for s in sections]

bounding_box = [helpers.curve_bounding_box(crv) for crv in curves]
polyline = [Polyline([point_to_rhino(pt) for pt in bbox.points]) for bbox in bounding_box]
box = [polyline_to_rhino(pl) for pl in polyline]

polygon = [crv.to_polygon(n=64) for crv in curves]

maximum_inscribed_circle = [gc.maximum_inscribed_circle(poly) for poly in polygon] 
growth_center = [c.center for c in maximum_inscribed_circle]
# ---------- end growthcenter ----------
triremesh_2 = TriRemesh(Geometry=mesh_2, Length=number_slider, Iterations=25)  # -> Triangulation, Dual, Creases; disabled
python_3_script = Python3Script(mesh=triremesh_2.Triangulation)  # -> out, cl; inputs mesh: Mesh; disabled
# ---------- python_3_script: Python ----------
#locate file in the same folder
from compas_rhino import unload_modules
from compas_rhino.conversions import mesh_to_compas
import sys
import os

#get current file path
path = ghenv.Component.OnPingDocument().FilePath
print (path)
#get parent directory of the parent directory
parentdir = os.path.dirname(path)
print (parentdir)
#get src folder which contains classes
dire = os.path.join(parentdir,'src')
print (dire)

sys.path.append(dire)

unload_modules('centerline_adv')

from centerline_adv import CenterlineExtractor

c_mesh = mesh_to_compas(mesh)

extractor = CenterlineExtractor(c_mesh)
cl = extractor.compute()

print(cl)
# ---------- end python_3_script ----------
deconstruct_mesh = DeconstructMesh(Mesh=triremesh.Triangulation)  # -> Vertices, Faces, Colours, Normals
compas_draw = COMPASDraw(cg=growthcenter.growth_center)  # -> rg
#   port cg: The COMPAS geometry or datastructure to be drawn.
#   port rg: The Rhino geometry object.
# ---------- compas_draw: Python ----------
# r: compas>=2.8.1
"""
Draws COMPAS geometry in Grasshopper.
"""

from typing import Any

import Grasshopper

from compas.scene import SceneObject


class CompasToRhinoGeometry(Grasshopper.Kernel.GH_ScriptInstance):
    def RunScript(self, cg):
        if not cg:
            return None

        return SceneObject(item=cg).draw()
# ---------- end compas_draw ----------
compas_draw_2 = COMPASDraw(cg=growthcenter.maximum_inscribed_circle)  # -> rg; same code as compas_draw
compas_draw_3 = COMPASDraw(cg=python_3_script.cl)  # -> rg; disabled; same code as compas_draw
python_3_script_2 = Python3Script(mesh=triremesh.Triangulation)  # -> out, polylines, direction, bbox; inputs mesh: Mesh
# ---------- python_3_script_2: Python ----------
#! python 3
# venv: forkwork
# r: compas, compas_cgal

#locate file in the same folder
from compas_rhino import unload_modules
from compas_rhino.conversions import mesh_to_compas, vector_to_rhino, point_to_rhino
import sys
import os

import compas_cgal

print(compas_cgal.__version__)

#get current file path
path = ghenv.Component.OnPingDocument().FilePath
print (path)
#get parent directory of the parent directory
parentdir = os.path.dirname(path)
print (parentdir)
#get src folder which contains classes
dire = os.path.join(parentdir,'src')
print (dire)

sys.path.append(dire)

unload_modules('centerline')
unload_modules('mesh_utils')

import centerline
import mesh_utils
#import mesh_geodesics

c_mesh = mesh_to_compas(mesh)

polylines = mesh_utils.skeletonize_mesh(c_mesh)
direction = centerline.branch_direction(c_mesh)
direction = vector_to_rhino(direction)

bbox = mesh_utils.mesh_bounding_box(c_mesh)
#bbox = [point_to_rhino(pt) for pt in bbox]

#contours = mesh_geodesics.iso_contours(c_mesh)
# ---------- end python_3_script_2 ----------
curve_2 = Curve(compas_draw_3)  # disabled
panel = Panel(curve_2)  # disabled
list_item = ListItem(List=deconstruct_mesh.Vertices, Index=0, Wrap=True)
compas_draw_4 = COMPASDraw(cg=python_3_script_2.polylines)  # -> rg; same code as compas_draw
compas_draw_5 = COMPASDraw(cg=python_3_script_2.bbox)  # -> rg; same code as compas_draw
join_curves = JoinCurves(Curves=compas_draw_4, Preserve=False)
end_points = EndPoints(Curve=join_curves)  # -> Start, End
line_sdl = LineSDL(Start=end_points.Start, Direction=python_3_script_2.direction, Length=Slider(1000, range=0..1000))
